% Simulink data dictionary agrivoltaics_v1_data_dict.sldd

Param = Simulink.Parameter([])

variable_bus = Simulink.Bus()
  a: double
  b: double

parameter_bus = Simulink.Bus()
  a: double
  b: double

inequality_constraint_bus = Simulink.Bus()
  a: double
  b: double

equality_constraint_bus = Simulink.Bus()
  a: double
  b: double

objective_bus = Simulink.Bus()
  e: double
  p: double

DHI = [0; 0; 0; 0; 0; 0; 24; 50; 64; 297; 395; 403; 453; 368; 106; 89; 76; 140; 31; 0; 0; 0; 0; 0]
DNI = [0; 0; 0; 0; 0; 0; 342; 662; 800; 282; 172; 104; 183; 14; 864; 842; 775; 12; 386; 0; 0; 0; 0; 0]

IVCurves = [struct(
  I=[4.50204; 4.49472; 4.48884; 4.48164; 4.47138; 4.45985; 4.42574; 4.40784; 4.40468; 4.4022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 -0.00222718],
  V=[0.00175191; 0.911824; 1.97675; 3.01497; 4.06362; 4.97604; 6.14163; 7.19992; 8.21476; 9.26073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 20.0437],
  Isc=4.50204,
  Imp=4.12762,
  Vmp=16.0564,
  Voc=20.0528,
  E=583.0604,
  Tc=34.824,
  Ee=583.0604), struct(
  I=[4.55226; 4.54973; 4.54912; 4.54701; 4.54471; 4.54296; 4.5401; 4.53723; 4.53383; 4.52908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 -0.00294955],
  V=[0.00181752; 0.913141; 1.91537; 2.90191; 3.89936; 4.88883; 5.9026; 6.78302; 7.91424; 8.91091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 19.9911],
  Isc=4.55226,
  Imp=4.19831,
  Vmp=15.9679,
  Voc=20.0049,
  E=589.2334,
  Tc=35.7624,
  Ee=589.2334), struct(
  I=[4.59471; 4.59058; 4.58537; 4.58108; 4.57709; 4.57383; 4.57022; 4.56705; 4.56346; 4.5602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 -0.00229054],
  V=[0.00175287; 0.86262; 1.89526; 2.90944; 3.90909; 4.63559; 5.90302; 6.89381; 7.91126; 8.87874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 19.9416],
  Isc=4.59471,
  Imp=4.22621,
  Vmp=15.9319,
  Voc=19.9557,
  E=594.5156,
  Tc=36.3598,
  Ee=594.5156), struct(
  I=[4.66713; 4.66392; 4.66045; 4.6558; 4.65361; 4.65218; 4.65119; 4.6473; 4.64497; 4.63897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 -0.00218521],
  V=[0.00170252; 0.845483; 1.90757; 2.9071; 3.88539; 4.89697; 5.89552; 6.87516; 7.76543; 8.88045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 19.9232],
  Isc=4.66713,
  Imp=4.30704,
  Vmp=15.8669,
  Voc=19.9269,
  E=603.6763,
  Tc=36.9413,
  Ee=603.6763), struct(
  I=[4.74499; 4.74062; 4.73545; 4.73308; 4.72947; 4.72591; 4.72159; 4.71656; 4.71194; 4.70619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 -0.00264492],
  V=[0.0017626; 0.893512; 1.88889; 2.89426; 3.86202; 4.76015; 5.88125; 6.87369; 7.86427; 8.8571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 19.9112],
  Isc=4.74499,
  Imp=4.36218,
  Vmp=15.847,
  Voc=19.9155,
  E=613.6838,
  Tc=37.1142,
  Ee=613.6838), struct(
  I=[4.78196; 4.77784; 4.7753; 4.77202; 4.76973; 4.76639; 4.76313; 4.7603; 4.7555; 4.75177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 -0.00246764],
  V=[0.00182672; 0.849388; 1.87606; 2.87524; 3.84345; 4.8491; 5.83088; 6.75876; 7.83057; 8.79723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 19.904],
  Isc=4.78196,
  Imp=4.40486,
  Vmp=15.8194,
  Voc=19.9105,
  E=618.4266,
  Tc=37.2186,
  Ee=618.4266), struct(
  I=[4.83824; 4.83202; 4.82849; 4.82613; 4.82332; 4.82108; 4.81674; 4.81249; 4.80891; 4.8044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 -0.00270231],
  V=[0.00158652; 0.779471; 1.86702; 2.84503; 3.84343; 4.65078; 5.81391; 6.78902; 7.78093; 8.64738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 19.8794],
  Isc=4.83824,
  Imp=4.45019,
  Vmp=15.8066,
  Voc=19.8882,
  E=625.4445,
  Tc=37.9157,
  Ee=625.4445), struct(
  I=[4.88795; 4.88628; 4.88258; 4.88044; 4.87825; 4.87734; 4.87509; 4.87053; 4.86609; 4.86101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 -0.00309046],
  V=[0.00210483; 0.755029; 1.86387; 2.74737; 3.83381; 4.82765; 5.79012; 6.78213; 7.75431; 8.62009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 19.8597],
  Isc=4.88795,
  Imp=4.49827,
  Vmp=15.7739,
  Voc=19.8672,
  E=631.8154,
  Tc=38.0617,
  Ee=631.8154), struct(
  I=[4.96259; 4.95739; 4.95329; 4.95008; 4.94724; 4.94444; 4.94099; 4.93783; 4.93405; 4.92976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 -0.00238947],
  V=[0.00176001; 0.877372; 1.85301; 2.83988; 3.82357; 4.81011; 5.79387; 6.76396; 7.66867; 8.7075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 19.8363],
  Isc=4.96259,
  Imp=4.57048,
  Vmp=15.7122,
  Voc=19.8432,
  E=641.1061,
  Tc=38.9946,
  Ee=641.1061), struct(
  I=[5.02224; 5.01491; 5.01087; 5.00832; 5.00648; 5.00235; 4.99978; 4.9965; 4.99378; 4.98965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 -0.0018876],
  V=[0.00155951; 0.896265; 1.81867; 2.84848; 3.85452; 4.8273; 5.70573; 6.82723; 7.78641; 8.71345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 19.8228],
  Isc=5.02224,
  Imp=4.61296,
  Vmp=15.6896,
  Voc=19.8307,
  E=648.8015,
  Tc=39.0221,
  Ee=648.8015), struct(
  I=[5.09801; 5.08697; 5.08268; 5.08041; 5.07826; 5.0749; 5.07225; 5.06728; 5.06419; 5.05942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 -0.00239488],
  V=[0.0013468; 0.908424; 1.87321; 2.73049; 3.83013; 4.79762; 5.72242; 6.75293; 7.72817; 8.7122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 19.8171],
  Isc=5.09801,
  Imp=4.68615,
  Vmp=15.656,
  Voc=19.8212,
  E=658.4499,
  Tc=39.3783,
  Ee=658.4499), struct(
  I=[5.14391; 5.14392; 5.13916; 5.13776; 5.13653; 5.1331; 5.12984; 5.12553; 5.12118; 5.11721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 -0.00252279],
  V=[0.00190582; 0.78164; 1.87047; 2.83761; 3.81645; 4.80114; 5.77428; 6.78295; 7.73979; 8.61295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 19.8059],
  Isc=5.14391,
  Imp=4.73144,
  Vmp=15.6282,
  Voc=19.8142,
  E=664.3426,
  Tc=39.4683,
  Ee=664.3426), struct(
  I=[5.17443; 5.16762; 5.16338; 5.16121; 5.15948; 5.15724; 5.15337; 5.14968; 5.1449; 5.13934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 -0.00372645],
  V=[0.00202858; 0.869733; 1.85737; 2.69131; 3.70009; 4.78426; 5.77164; 6.76076; 7.71965; 8.68596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 19.7764],
  Isc=5.17443,
  Imp=4.74958,
  Vmp=15.6138,
  Voc=19.7832,
  E=668.0897,
  Tc=39.9563,
  Ee=668.0897), struct(
  I=[5.19512; 5.18985; 5.18602; 5.18464; 5.1818; 5.17905; 5.17501; 5.17006; 5.16475; 5.15968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 -0.00211227],
  V=[0.00194304; 0.882999; 1.85814; 2.81209; 3.79072; 4.75701; 5.6439; 6.71722; 7.61844; 8.64815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 19.7533],
  Isc=5.19512,
  Imp=4.77059,
  Vmp=15.5741,
  Voc=19.767,
  E=670.6074,
  Tc=40.3404,
  Ee=670.6074), struct(
  I=[5.2912; 5.28926; 5.28385; 5.28165; 5.27903; 5.27567; 5.27268; 5.26858; 5.26448; 5.26048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 -0.00136353],
  V=[0.00214697; 0.735412; 1.84743; 2.7168; 3.7977; 4.77803; 5.64338; 6.73975; 7.71295; 8.6771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 19.7476],
  Isc=5.2912,
  Imp=4.85722,
  Vmp=15.568,
  Voc=19.7558,
  E=682.7966,
  Tc=40.8638,
  Ee=682.7966), struct(
  I=[5.33134; 5.32267; 5.31774; 5.31472; 5.31258; 5.31063; 5.30779; 5.30358; 5.29969; 5.29376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 -0.00207409],
  V=[0.00176597; 0.878517; 1.81755; 2.80078; 3.77019; 4.72943; 5.68824; 6.67758; 7.67923; 8.62044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 19.7299],
  Isc=5.33134,
  Imp=4.8851,
  Vmp=15.5285,
  Voc=19.7311,
  E=687.9217,
  Tc=40.9972,
  Ee=687.9217), struct(
  I=[5.38434; 5.38154; 5.37817; 5.37539; 5.37374; 5.36994; 5.36659; 5.36273; 5.35776; 5.35344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 -0.00257459],
  V=[0.00219737; 0.79707; 1.7946; 2.81238; 3.76478; 4.72931; 5.69683; 6.67649; 7.63909; 8.48538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 19.7252],
  Isc=5.38434,
  Imp=4.93431,
  Vmp=15.5039,
  Voc=19.7273,
  E=694.6236,
  Tc=41.3277,
  Ee=694.6236), struct(
  I=[5.43453; 5.43103; 5.42727; 5.42513; 5.42199; 5.41832; 5.41483; 5.41083; 5.40719; 5.40246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 -0.00242566],
  V=[0.00189383; 0.811975; 1.84747; 2.7919; 3.77849; 4.69945; 5.68762; 6.66729; 7.64318; 8.5883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 19.738],
  Isc=5.43453,
  Imp=4.98583,
  Vmp=15.5054,
  Voc=19.7424,
  E=701.1749,
  Tc=41.1451,
  Ee=701.1749), struct(
  I=[5.47611; 5.47351; 5.4718; 5.47011; 5.46801; 5.4648; 5.46125; 5.45765; 5.456; 5.45173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 -0.00266911],
  V=[0.00207783; 0.865018; 1.82558; 2.77842; 3.65433; 4.71024; 5.6725; 6.63972; 7.50532; 8.57215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 19.7374],
  Isc=5.47611,
  Imp=5.03288,
  Vmp=15.497,
  Voc=19.7431,
  E=706.3445,
  Tc=41.6085,
  Ee=706.3445), struct(
  I=[5.53856; 5.53633; 5.53293; 5.53019; 5.5272; 5.5247; 5.52272; 5.52027; 5.51681; 5.51267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 -0.000896232],
  V=[0.00224929; 0.764306; 1.83242; 2.813; 3.76922; 4.6276; 5.6898; 6.68455; 7.59163; 8.60439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 19.7406],
  Isc=5.53856,
  Imp=5.08452,
  Vmp=15.4713,
  Voc=19.7412,
  E=714.5307,
  Tc=41.3009,
  Ee=714.5307), struct(
  I=[5.58897; 5.58188; 5.57889; 5.57676; 5.57499; 5.57431; 5.57161; 5.56865; 5.56354; 5.55789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 -0.00210288],
  V=[0.00220741; 0.868024; 1.73287; 2.79271; 3.76408; 4.74963; 5.64376; 6.51343; 7.63205; 8.59756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 19.745],
  Isc=5.58897,
  Imp=5.12917,
  Vmp=15.4784,
  Voc=19.7443,
  E=720.8011,
  Tc=41.843,
  Ee=720.8011), struct(
  I=[5.62748; 5.62007; 5.61742; 5.61488; 5.61155; 5.60844; 5.60478; 5.6014; 5.59802; 5.59248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 -0.00177766],
  V=[0.0019432; 0.872606; 1.85571; 2.81232; 3.67519; 4.75474; 5.73948; 6.70231; 7.5571; 8.64677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 19.7504],
  Isc=5.62748,
  Imp=5.15501,
  Vmp=15.4749,
  Voc=19.7607,
  E=725.8469,
  Tc=41.66,
  Ee=725.8469), struct(
  I=[5.62973; 5.62541; 5.62315; 5.6216; 5.6195; 5.61609; 5.61207; 5.60777; 5.60261; 5.59784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 -0.00227556],
  V=[0.00189826; 0.869623; 1.82466; 2.80075; 3.77342; 4.73649; 5.69179; 6.67179; 7.64714; 8.60127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 19.7333],
  Isc=5.62973,
  Imp=5.1654,
  Vmp=15.4704,
  Voc=19.7407,
  E=726.0057,
  Tc=41.9636,
  Ee=726.0057), struct(
  I=[5.71216; 5.70693; 5.7037; 5.7008; 5.69875; 5.6953; 5.69193; 5.68983; 5.68629; 5.68165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 -0.0023595],
  V=[0.00212461; 0.777559; 1.84281; 2.81592; 3.76926; 4.72363; 5.68827; 6.5971; 7.61916; 8.57246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 19.7409],
  Isc=5.71216,
  Imp=5.24984,
  Vmp=15.4252,
  Voc=19.7463,
  E=736.7624,
  Tc=41.6753,
  Ee=736.7624), struct(
  I=[5.78425; 5.7781; 5.77475; 5.77614; 5.7695; 5.76508; 5.76008; 5.75643; 5.75191; 5.74691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 -0.00215144],
  V=[0.00205813; 0.862315; 1.77447; 1.92254; 3.74711; 4.70748; 5.67057; 6.64659; 7.60699; 8.41693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 19.7557],
  Isc=5.78425,
  Imp=5.29056,
  Vmp=15.448,
  Voc=19.7677,
  E=746.0323,
  Tc=41.7392,
  Ee=746.0323), struct(
  I=[5.7712; 5.76544; 5.7646; 5.76197; 5.76003; 5.75728; 5.75534; 5.7522; 5.74931; 5.74501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 -0.00216083],
  V=[0.00192591; 0.845736; 1.83471; 2.795; 3.73489; 4.72112; 5.62594; 6.63296; 7.60403; 8.55389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 19.761],
  Isc=5.7712,
  Imp=5.30333,
  Vmp=15.457,
  Voc=19.7675,
  E=744.4655,
  Tc=41.477,
  Ee=744.4655), struct(
  I=[5.82532; 5.82326; 5.82225; 5.81977; 5.81632; 5.8135; 5.81084; 5.80789; 5.80362; 5.79807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 -0.00239308],
  V=[0.00212017; 0.880996; 1.83442; 2.7964; 3.64716; 4.71554; 5.67911; 6.65678; 7.59973; 8.58074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 19.7619],
  Isc=5.82532,
  Imp=5.34597,
  Vmp=15.4259,
  Voc=19.7663,
  E=751.2372,
  Tc=41.945,
  Ee=751.2372), struct(
  I=[5.86939; 5.86742; 5.86354; 5.8615; 5.85933; 5.85686; 5.85373; 5.8496; 5.84481; 5.83841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 -0.00245626],
  V=[0.00209374; 0.867613; 1.84144; 2.80359; 3.74471; 4.72619; 5.68826; 6.64378; 7.5956; 8.56798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 19.7599],
  Isc=5.86939,
  Imp=5.37612,
  Vmp=15.428,
  Voc=19.762,
  E=756.9155,
  Tc=41.9561,
  Ee=756.9155), struct(
  I=[5.92759; 5.92658; 5.92415; 5.92364; 5.92172; 5.91948; 5.9167; 5.91339; 5.90965; 5.9042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 -0.00159199],
  V=[0.00232284; 0.858428; 1.8143; 2.67577; 3.72915; 4.67943; 5.64582; 6.61035; 7.56937; 8.53024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 19.7669],
  Isc=5.92759,
  Imp=5.44388,
  Vmp=15.4323,
  Voc=19.7738,
  E=764.4214,
  Tc=41.955,
  Ee=764.4214), struct(
  I=[5.93163; 5.92814; 5.92597; 5.92197; 5.91794; 5.91325; 5.90996; 5.90553; 5.90255; 5.89878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 -0.00252901],
  V=[0.00217264; 0.869071; 1.80928; 2.77154; 3.76046; 4.68859; 5.51108; 6.52135; 7.57687; 8.53587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 19.766],
  Isc=5.93163,
  Imp=5.44772,
  Vmp=15.415,
  Voc=19.7673,
  E=764.8645,
  Tc=42.1259,
  Ee=764.8645), struct(
  I=[6.01041; 6.01082; 6.00961; 6.00796; 6.00667; 6.00369; 6.00177; 5.99743; 5.99215; 5.98492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 -0.00289296],
  V=[0.00222384; 0.887755; 1.82443; 2.67947; 3.70522; 4.7198; 5.68185; 6.62888; 7.51225; 8.57587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 19.7591],
  Isc=6.01041,
  Imp=5.52072,
  Vmp=15.3867,
  Voc=19.7691,
  E=774.8609,
  Tc=42.477,
  Ee=774.8609), struct(
  I=[6.04993; 6.04956; 6.04669; 6.04405; 6.04205; 6.03883; 6.0371; 6.03333; 6.02824; 6.02091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 -0.00217824],
  V=[0.00252628; 0.855487; 1.80704; 2.76695; 3.72901; 4.70811; 5.59706; 6.59536; 7.56414; 8.51406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 19.7336],
  Isc=6.04993,
  Imp=5.54585,
  Vmp=15.3466,
  Voc=19.7494,
  E=779.8335,
  Tc=42.7401,
  Ee=779.8335), struct(
  I=[6.09251; 6.09028; 6.08748; 6.08574; 6.08287; 6.08274; 6.07945; 6.07647; 6.07207; 6.06644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 -0.0025282],
  V=[0.00229818; 0.751041; 1.80762; 2.77292; 3.72846; 4.68596; 5.5265; 6.60045; 7.51962; 8.48179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 19.7138],
  Isc=6.09251,
  Imp=5.5918,
  Vmp=15.3191,
  Voc=19.7163,
  E=785.1416,
  Tc=43.1261,
  Ee=785.1416), struct(
  I=[6.12702; 6.12237; 6.12001; 6.11724; 6.11611; 6.11327; 6.10969; 6.10536; 6.09952; 6.0925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 -0.00312503],
  V=[0.00215972; 0.860845; 1.81861; 2.75902; 3.70861; 4.65816; 5.60189; 6.5538; 7.49276; 8.37478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 19.6936],
  Isc=6.12702,
  Imp=5.60881,
  Vmp=15.3013,
  Voc=19.6936,
  E=789.6366,
  Tc=43.0245,
  Ee=789.6366), struct(
  I=[6.15352; 6.15189; 6.14961; 6.14818; 6.14794; 6.14387; 6.14055; 6.13577; 6.12947; 6.12344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 -0.00173669],
  V=[0.00251562; 0.848556; 1.82092; 2.77044; 3.06476; 4.68778; 5.70192; 6.47751; 7.54726; 8.53598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 19.6847],
  Isc=6.15352,
  Imp=5.63803,
  Vmp=15.2861,
  Voc=19.6868,
  E=793.1174,
  Tc=42.8858,
  Ee=793.1174), struct(
  I=[6.17565; 6.17128; 6.16861; 6.1659; 6.16468; 6.16209; 6.15814; 6.15372; 6.14936; 6.14356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 -0.00203609],
  V=[0.00235891; 0.850516; 1.80392; 2.76048; 3.71653; 4.6644; 5.61251; 6.48206; 7.52131; 8.43952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 19.6808],
  Isc=6.17565,
  Imp=5.65531,
  Vmp=15.2863,
  Voc=19.6764,
  E=795.9263,
  Tc=42.9773,
  Ee=795.9263), struct(
  I=[6.19151; 6.18821; 6.1863; 6.18389; 6.18251; 6.18206; 6.17898; 6.17442; 6.17045; 6.1625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 -0.00245284],
  V=[0.0022016; 0.853355; 1.8032; 2.75638; 3.69155; 4.62086; 5.5722; 6.52365; 7.22972; 8.41632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 19.6657],
  Isc=6.19151,
  Imp=5.66493,
  Vmp=15.2727,
  Voc=19.6744,
  E=798.121,
  Tc=42.6604,
  Ee=798.121), struct(
  I=[6.2089; 6.20451; 6.2; 6.19635; 6.19304; 6.18974; 6.18637; 6.18379; 6.18095; 6.17506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 -0.00304108],
  V=[0.0021866; 0.857915; 1.80986; 2.7617; 3.71933; 4.68038; 5.60604; 6.56868; 7.40361; 8.47102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 19.6187],
  Isc=6.2089,
  Imp=5.68153,
  Vmp=15.2069,
  Voc=19.6294,
  E=799.5844,
  Tc=44.2945,
  Ee=799.5844), struct(
  I=[6.28484; 6.27711; 6.27304; 6.27005; 6.26728; 6.26493; 6.26281; 6.26048; 6.25657; 6.25239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 -0.00202074],
  V=[0.00204604; 0.845028; 1.82571; 2.64353; 3.69515; 4.65724; 5.59256; 6.54839; 7.4896; 8.30963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 19.5982],
  Isc=6.28484,
  Imp=5.74281,
  Vmp=15.1824,
  Voc=19.6072,
  E=809.4222,
  Tc=44.1737,
  Ee=809.4222), struct(
  I=[6.27734; 6.27374; 6.26793; 6.26581; 6.26448; 6.26189; 6.25982; 6.25557; 6.25066; 6.24588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 -0.00205549],
  V=[0.0023579; 0.853988; 1.78966; 2.74416; 3.57372; 4.61376; 5.56582; 6.52366; 7.48583; 8.37456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 19.596],
  Isc=6.27734,
  Imp=5.73906,
  Vmp=15.1734,
  Voc=19.5969,
  E=808.5188,
  Tc=44.0438,
  Ee=808.5188)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]

Specs = struct(Ns=36, aIsc=0.0054, bVoc=-0.0774, Type="Mitsubishi PV-UE125MF5N cSi")
Topocentric_azimuth_angle = [168.86; 188.04; 206.37; 222.44; 236.04; 247.73; 258.22; 268.25; 278.57; 290.08; 303.99; 321.92; 344.96; 11; 34.75; 53.42; 67.83; 79.6; 90.02; 100.03; 110.39; 121.82; 135.08; 150.77]
Topocentric_zenith_angle = [128.98; 129.3; 126.01; 119.74; 111.34; 101.57; 90.97; 79.88; 68.87; 58.16; 48.29; 40.16; 35.18; 34.8; 39.17; 46.92; 56.6; 67.24; 78.26; 88.98; 100.1; 110.07; 118.78; 125.49]
beta_s = [-0.6803293; -0.6859144; -0.6284931; -0.5190609; -0.3724533; -0.2019346; -0.01692969; 0.1766273; 0.3687881; 0.5557128; 0.7279768; 0.8698721; 0.9567895; 0.9634217; 0.8871509; 0.7518878; 0.58294; 0.3972369; 0.2049017; 0.01780236; -0.1762783; -0.3502876; -0.5023058; -0.6194174]
crop_price = 0.5
electricity_price = 0.5
l_p = 1
land_angle = 0
land_x = 50
land_y = 50
model_name = "agrivoltaics_v1"
n_p = 0.2
parameters = [50; 50; 0; 0.2; 0.5; 0.5]
params = struct(land=[50; 50; 0], weather=[], PV=0.2, crop=[0.5; 0.5], sus=[], econ=[])
phi = 0
phi_s = [-2.947163; -3.281917; -3.601836; -3.88231; -4.119675; -4.323704; -4.506789; -4.681846; -4.861964; -5.062851; -5.305626; -5.618564; -6.020688; -0.1919862; -0.6065019; -0.9323549; -1.183857; -1.389282; -1.571145; -1.745853; -1.926669; -2.12616; -2.357591; -2.631433]
psi = 0
theta = 0.7853982
time_vector = [1; 2; 3; 4; 5; 6; 7; 8; 9; 10; 11; 12; 13; 14; 15; 16; 17; 18; 19; 20; 21; 22; 23; 24]
var = struct(PV=[2; 1; 1; 0; 0.7853982; 0; 1; 0.1], crop=[])
variable_a = [0 5; 1 5]
variable_b = [0 6; 1 6]
variables = [2; 1; 1; 0; 0.7853982; 0; 1; 0.1]
w_p = 1
x_p = 0.1
y_p = 1
z_p = 2