% Simulink data dictionary agrivoltaics_v1_data_dict.sldd

Param = Simulink.Parameter([])

variable_bus = Simulink.Bus()
  a: double
  b: double

parameter_bus = Simulink.Bus()
  a: double
  b: double

inequality_constraint_bus = Simulink.Bus()
  a: double
  b: double

equality_constraint_bus = Simulink.Bus()
  a: double
  b: double

objective_bus = Simulink.Bus()
  e: double
  p: double